# Grasshopper definition mesh_union_toggle.gh (Grasshopper 1.0.7)

mesh = Mesh([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])
meshes = GetGeometry(mesh, AtLeast=1, AtMost=2147483647, DeleteInput=False, Filter=1073741872, TreeAccess=False)
merge = GetBoolean(Toggle(False), AtLeast=1, AtMost=1, FalseValue="False", TreeAccess=False, TrueValue="True")
scale = GetNumber(Slider(0.561, range=0..1), AtLeast=1, AtMost=1, Maximum=1.797693135e+308, Minimum=-1.797693135e+308, TreeAccess=False)
panel = Panel(meshes)
gate = StreamGate(Stream=meshes, Gate=merge)  # -> Target0, Target1
munion = MeshUnion(Meshes=gate.Target1)
faceb = FaceBoundaries(Mesh=munion)
pcen = PolygonCenter(Polyline=faceb)  # -> CenterV, CenterE, CenterA
scale_2 = Scale(Geometry=faceb, Center=pcen.CenterV, Factor=scale)  # -> Geometry, Transform
explode = Explode(Curve=faceb, Recursive=True)  # -> Segments, Vertices
explode_2 = Explode(Curve=scale_2.Geometry, Recursive=True)  # -> Segments, Vertices
end = EndPoints(Curve=explode.Segments)  # -> Start, End
end_2 = EndPoints(Curve=explode_2.Segments)  # -> Start, End
merge_2 = Merge(Data1=graft(end.Start), Data2=graft(end.End), Data3=graft(end_2.End), Data4=graft(end_2.Start))
conmesh = ConstructMesh(Vertices=merge_2, Faces={A=0, B=1, C=2, D=3})
mjoin = MeshJoin(Meshes=flatten(conmesh))

# ---- group: RH_OUT:mesh
mesh_2 = Mesh([gate.Target0, mjoin])
